# Grasshopper definition gh_read_csv.ghx (Grasshopper 0.9.76)
# plug-ins: Python Interpreter, GH_CPython

panel = Panel("C:/Users/yoshioca/Documents/AnalyzingSound_Rice/result/WashingRice_out_edit.csv")
read_csv = GH_CPython(path=panel)  # -> output, header, datalist_flip, hz_count, frame_count; inputs path: list
#   port path: [required] - [type = int] - [default = None] Descripe your input here * bullet point. * bullet point
#   port output: indicate your output description here. refers to a new line.
# ---------- read_csv: Python ----------
import csv
import math



def access_csv(fp):
    # filePath = '../result/WashingRice_out_edit.csv'
    file_path = fp
    f = open(file_path, "r")
    reader = csv.reader(f)
    # print(type(reader))
    # <class '_csv.reader'>

    return reader



def get_header_data(fp):

    header_data = []
    tmp_reader = access_csv(fp)
    for i, row in enumerate(tmp_reader):
        if i is 0:
            row_length = len(row)
            for j in range(row_length):
                ### cast, str -> float
                header_data.append(float(row[j]))

    return header_data



def get_matrix_data(fp, haed_bool):
    all_data = []
    tmp_reader = access_csv(fp)

    ### HEADER : True
    if haed_bool:
        for i, row in enumerate(tmp_reader):
            if i is not 0:
                all_data.append(row)

    ### HEADER : False
    else:
        for i, row in enumerate(tmp_reader):
            all_data.append(row)

    return all_data



def flip_array(data):
    flip_array = []

    u = len(data)
    v = len(data[0])
    for i in range(v):
        tmp_val = []
        for j in range(u):
            ### cast, str -> float
            tmp_val.append(float(data[j][i]))
        flip_array.append(tmp_val)

    return flip_array


def calc_data(data):
    return len(data[0]), len(data)






# FilePath = '../result/WashingRice_out_edit.csv'
FilePath = str(path)



head = get_header_data(FilePath)
data = get_matrix_data(FilePath, True)
Hz, frame = calc_data(data)
# print(len(data))

### operate date
data_flip = flip_array(data)




### Export Component-Out
output_ = FilePath
header = head
datalist_flip = data_flip ### omoi
hz_count = Hz
frame_count = frame
# ---------- end read_csv ----------

crv = Curve([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])
preview = CustomPreview(Geometry=crv, Material=ColourSwatch(SwatchColor=RGB(255, 255, 255)))

chop_1_8000hz = GH_CPython(input=read_csv.header)  # -> graft(output); inputs input: list
#   port input: [required] - [type = int] - [default = None] Descripe your input here * bullet point. * bullet point
#   port output: indicate your output description here. refers to a new line.
# ---------- chop_1_8000hz: Python ----------
mp_List = []

for i in xrange(len(_input)):
    tmp_value = float(_input[i])
    if tmp_value < 0 or tmp_value > 8000:
        mp_List.append(False)
    else:
        mp_List.append(True)

output_ = mp_List
# ---------- end chop_1_8000hz ----------
panel_2 = Panel(chop_1_8000hz)
partition = PartitionList(List=read_csv.datalist_flip, Size=read_csv.frame_count)
dispatch = Dispatch(List=partition, DispatchPattern=chop_1_8000hz)  # -> ListA, ListB
graft = GraftTree(Tree=read_csv.header, IncludeEmptyLists=True, IncludeNullItems=True)
dispatch_2 = Dispatch(List=graft, DispatchPattern=chop_1_8000hz)  # -> ListA, ListB
clean = CleanTree(RemoveNulls=True, RemoveInvalid=True, RemoveEmpty=Toggle(True), Tree=dispatch_2.ListA)  # -> flatten(Tree)
clean_2 = CleanTree(RemoveNulls=True, RemoveInvalid=True, RemoveEmpty=Toggle(True), Tree=dispatch.ListA)
number_slider = Slider(5, range=0..10)
panel_3 = Panel(clean)
flip = FlipMatrix(Data=clean_2)
flip_2 = FlipMatrix(Data=clean_2)
merge = Merge()
lng = ListLength(List=flip_2)  # -> flatten(Length)
lng_2 = ListLength(List=clean_2)  # -> flatten(Length)
flip_3 = FlipMatrix(Data=clean_2)
item = ListItem(List=lng, Index=0, Wrap=True)
integer_division = IntegerDivision(A=item, B=number_slider)
split = SplitList(List=flip, Index=integer_division)  # -> ListA, ListB
split_2 = SplitList(List=split.ListB, Index=integer_division)  # -> ListA, ListB
item_2 = ListItem(List=lng_2, Index=0, Wrap=True)
split_3 = SplitList(List=split_2.ListB, Index=integer_division)  # -> ListA, ListB
split_4 = SplitList(List=split_3.ListB, Index=integer_division)  # -> ListA, ListB
lng_3 = ListLength(List=flip_3)  # -> flatten(Length)
viewer = ParamViewer(flip_3)
item_3 = ListItem(List=lng_3, Index=0, Wrap=True)
ma = MassAddition(Input=split.ListA)  # -> flatten(Result), PartialResults
ma_2 = MassAddition(Input=split_2.ListA)  # -> flatten(Result), PartialResults
multiplication = Multiplication(A=flip_3, B=Slider(3.5, range=0..10))
ma_3 = MassAddition(Input=split_3.ListA)  # -> flatten(Result), PartialResults
panel_4 = Panel(item_2)
division = Division(A=Slider(1200, range=0..10000), B=item_3)
ma_4 = MassAddition(Input=split_4.ListB)  # -> flatten(Result), PartialResults
ma_5 = MassAddition(Input=split_4.ListA)  # -> flatten(Result), PartialResults
panel_5 = Panel(item)
series = Series(Start=0, Step=division, Count=item_3)
bnd = Bounds(Numbers=series)
number_slider_2 = Slider(1, range=0..10)
number_slider_3 = Slider(0, range=0..10)
number_slider_4 = Slider(0.57, range=0..1)
pt = ConstructPoint(XCoordinate=series, YCoordinate=multiplication, ZCoordinate=0)
flatten = FlattenTree(Tree=clean_2, Path="{0}")
viewer_2 = ParamViewer(flatten)
python = GhPythonScript(x=ma.Result, in_r=number_slider_2, inter_d=number_slider_3, amp=number_slider_4)  # -> out, a; inputs x: list
# ---------- python: Python ----------
import random
import rhinoscriptsyntax as rs


a = []
zigzag = []
pl_off = []


# convert values to poliline
def wave_line(values, r, in_d):
    
    ### interpolation dist
    # inter_dist = 4 * 0.5
    inter_dist = in_d
    
    for i in xrange(len(values)):
        tmp_pt = rs.AddPoint(values[i]*amp, i*r, 0)
        tmp_pt_m = rs.MirrorObject(tmp_pt, (0,0,0), (0,10,0), True)
        
        # zigzag
        if i%2 == 0:
            tmp_pt_0 = rs.CopyObject(tmp_pt)
            tmp_pt_0 = rs.MoveObject(tmp_pt_0, (0,-1*(inter_dist),0))
            tmp_pt_1 = rs.CopyObject(tmp_pt)
            tmp_pt_1 = rs.MoveObject(tmp_pt_1, (0,1*(inter_dist),0))
            zigzag.append(tmp_pt_0)
            zigzag.append(tmp_pt_1)
        else:
            tmp_pt_0 = rs.CopyObject(tmp_pt_m)
            tmp_pt_0 = rs.MoveObject(tmp_pt_0, (0,-1*(inter_dist),0))
            tmp_pt_1 = rs.CopyObject(tmp_pt_m)
            tmp_pt_1 = rs.MoveObject(tmp_pt_1, (0,1*(inter_dist),0))
            zigzag.append(tmp_pt_0)
            zigzag.append(tmp_pt_1)
        
    tmp_polyline = rs.AddPolyline(zigzag)
    return zigzag, tmp_polyline



pts, pl = wave_line(x, in_r, inter_d)

a = pl
# ---------- end python ----------
python_2 = GhPythonScript(x=ma_2.Result, in_r=number_slider_2, inter_d=number_slider_3, amp=number_slider_4)  # -> out, a; inputs x: list; same code as python
python_3 = GhPythonScript(x=ma_5.Result, in_r=number_slider_2, inter_d=number_slider_3, amp=number_slider_4)  # -> out, a; inputs x: list; same code as python
python_4 = GhPythonScript(x=ma_3.Result, in_r=number_slider_2, inter_d=number_slider_3, amp=number_slider_4)  # -> out, a; inputs x: list; same code as python
python_5 = GhPythonScript(x=ma_4.Result, in_r=number_slider_2, inter_d=number_slider_3, amp=number_slider_4)  # -> out, a; inputs x: list; same code as python
pline = PolyLine(Vertices=pt, Closed=False)  # -> flatten(Polyline)
lng_4 = ListLength(List=pline)
python_6 = PythonScript(datalist=flatten, hz_count=item, frame_count=item_2, final_crv_count=number_slider)  # -> out, a; inputs datalist: list
# ---------- python_6: Python ----------
split_count = int(hz_count/final_crv_count)*frame_count
print split_count
# ---------- end python_6 ----------
series_2 = Series(Start=0, Step=1, Count=lng_4)
number_slider_5 = Slider(200, range=0..1000)
panel_6 = Panel(lng_4)
merge_2 = Merge(Data1=python.a, Data2=python_2.a, Data3=python_4.a, Data4=python_3.a, Data5=python_5.a)
Y = UnitY(Factor=series_2)
panel_7 = Panel(python.a)
lng_5 = ListLength(List=merge_2)
series_3 = Series(Start=number_slider_5, Step=number_slider_5, Count=lng_5)
move = Move(Geometry=pline, Motion=Y)  # -> Geometry, Transform
X = UnitX(Factor=series_3)
dispatch_3 = Dispatch(List=move.Geometry, DispatchPattern=[True, False])  # -> ListA, ListB
crv_2 = Curve(dispatch_3.ListB)
move_2 = Move(Geometry=merge_2, Motion=X)  # -> Geometry, Transform
